# Grasshopper definition vaMatchBeamRoll.gh (Grasshopper 1.0.7)
# plug-ins: GhVa30, TbGh21

beam_to_rotate = GetObject(AllowedClassSetMask=4, AtLeast=1, AtMost=1, DeleteInput=True, Prompt="Select the beams to rotate")
source_beam = GetObject(AllowedClassSetMask=4, AtLeast=1, AtMost=1, DeleteInput=False, Prompt="Select Source Beam")
beam_to_modify = Beam(beam_to_rotate)
source_beam_2 = Beam(source_beam)
deconstruct_beam = DeconstructBeam(Beam=source_beam_2)  # -> Curve, Options
unit_x = UnitX(Factor=1)
angle = Angle(VectorA=unit_x, VectorB=deconstruct_beam.Curve)  # -> Angle, Reflex
pi = Pi(Factor=1)
multiplication = Multiplication(A=pi, B=0.5)
deg = Degrees()
addition = Addition(A=angle.Angle, B=multiplication)
set_property_value = SetPropertyValue(Object=beam_to_modify, Property="profileRoll", Value=addition)
context_bake = ContextBake(Geometry=set_property_value)
